# Grasshopper definition IceRayLatticeBasic.gh (Grasshopper 1.0.8)
# plug-ins: Karamba3D, RhinoCodePluginGH, Human

# ----
# ITERATION CONTROL
# animate slider
# total number should equal to number of experiments x number of iterations
# iterate here -->
number_slider = Slider(0, range=0..14)

# ----
# Number of Iterations per Experiment
number_slider_2 = Slider(12, range=0..100)
# GLOBAL PARAMETERS
number_slider_3 = Slider(1, range=0..10)
# EXPERIMENT PARAMETERS
# 0) Automation Geneneration
number_slider_4 = Slider(3, range=0..10)

# ---- group: Turn on this to start recording; rewrites over file
boolean_toggle = BooleanToggle(False)

# ----
C = Count(number_slider_2)
reset = Button()
series = Series(Start="1", Step=1, Count=Slider(2, range=0..10))
# Global Tolerance
num = Number("1e-3")
# Total Volume
num_2 = Number(number_slider_3)
txt = Text("C:/test_data/data_stream_test.csv")
series_2 = Series(Start=0, Step=1, Count=number_slider_4)
bool = Boolean(boolean_toggle)
series_3 = Series(Start=0, Step=1, Count=Slider(3, range=0..10))
series_4 = Series(Start=0, Step=1, Count=Slider(2, range=0..10))
series_5 = Series(Start=0, Step=1, Count=Slider(6, range=0..10))
# 1) Custom Definition
global_parameters_for_each_experiment = Panel("list_of_params=[[0,1,0.2,0,0,0],]")
panel = Panel(series_2)
panel_2 = Panel(series_4)
panel_3 = Panel(series_5)
panel_4 = Panel(series_3)
panel_5 = Panel(series)
cross_reference = CrossReference(
    ListListA=panel,
    ListListB=panel_5,
    ListA=Slider(0.2, range=0..1),
    ListB=panel_4,
    ListC=panel_3,
    ListD=panel_2,
    CrossMode=1)  # -> ListListA, ListListB, ListA, ListB, ListC, ListD
ghpython_script = GhPythonScript(Code=global_parameters_for_each_experiment)  # -> Out, List_of_params

# ----
# right click on input
# -chose 'list access'
# -set 'type hint' to 'int'
ghpython_script_2 = GhPythonScript(
    a=cross_reference.ListListA,
    b=cross_reference.ListListB,
    c=cross_reference.ListA,
    d=cross_reference.ListB,
    e=cross_reference.ListC,
    f=cross_reference.ListD)  # -> out, list_of_params; inputs a: list, b: list, c: list, d: list, e: list, f: list
# ---------- ghpython_script_2: Python ----------
__author__ = "User"
__version__ = "2024.05.02"

import rhinoscriptsyntax as rs

list_of_params = list(zip(a,b,c,d,e,f))  # include all options here

list_of_params = [list(_x) for _x in list_of_params]
# ---------- end ghpython_script_2 ----------

# ----
# 0 or 1
boolean_toggle_2 = BooleanToggle(True)
panel_6 = Panel(ghpython_script_2.list_of_params)
data = Data(ghpython_script_2.list_of_params)
data_2 = Data(ghpython_script.List_of_params)

# ---- group: Automated OR Manual
stream_filter = StreamFilter(Gate=boolean_toggle_2, Stream0=data, Stream1=data_2)

# ----
# Selection: Attribute
panel_7 = Panel("1")
# selection percentage
panel_8 = Panel("3")
# Starting Design
panel_9 = Panel("5")
# Cross Section
panel_10 = Panel("6")
# Selection: Strategy
panel_11 = Panel("2")
# Design Rule
panel_12 = Panel("4")
data_3 = Data(stream_filter)
curve = Curve([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])
curve_2 = Curve([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])
curve_3 = Curve([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])
# ITERATION SETUP
data_4 = Data(C)
list_length = ListLength(List=data_3)
srf = Surface(curve_2)
srf_2 = Surface(curve)
srf_3 = Surface(curve_3)
number = Number(Slider(2.44, range=0..4))
number_2 = Number(Slider(3.23, range=0..4))
integer = Integer(list_length)
C_2 = Count(integer)
C_3 = Count(data_4)
series_6 = Series(Start=0, Step=1, Count=C_3)
series_7 = Series(Start=0, Step=1, Count=C_2)
number_3 = Number(number)
number_4 = Number(number_2)
point = Point([Point(0, 3.23, 0), Point(0, 0, 0), Point(19.52, 3.23, 0), Point(19.52, 0, 0)])
# Supports
# hand drawn dots to represent joints
point_2 = Point([Point(0, 0, 0), Point(2.44, 0, 0)])
# DESIGN INITIALISATION
# for experiments
# Layout
rectangle = Rectangle(Plane=PlaneXY(0, 0, 0), XSize=number_3, YSize=number_4, Radius=0)  # -> Rectangle, Length
point_3 = Point([Point(0, 0, 0), Point(0, 3.23, 0)])
cross_reference_2 = CrossReference(ListListA=series_6, ListListB=series_7, CrossMode=1)  # -> ListListA, ListListB
integer_2 = Integer(number_slider)
entwine = Entwine(Branch00=point_2, Branch01=point, Branch02=point_3, Branch03=point, Branch04=point, Branch05=point_2, FlattenInputs=True)  # -> simplify(Result)
curve_4 = Curve(rectangle.Rectangle)
num_3 = Number(number)
curve_5 = Curve(curve_4)
integer_3 = Integer(cross_reference_2.ListListA)
integer_4 = Integer(cross_reference_2.ListListB)
# Current Experiment
list_length_2 = ListLength(List=integer_4)
series_8 = Series(Start=0, Step=num_3, Count=Slider(8, range=0..10))
list_item = ListItem(List=integer_4, Index=integer_2, Wrap=True)
list_item_2 = ListItem(List=integer_3, Index=integer_2, Wrap=True)
unit_x = UnitX(Factor=series_8)
integer_5 = Integer(list_length_2)
data_5 = Data(list_item)
# Current Experiment Parameters
list_item_3 = ListItem(List=data_3, Index=data_5, Wrap=True)
ghpython_script_3 = GhPythonScript(x=list_item_3)  # -> out, params
# ---------- ghpython_script_3: Python ----------
__author__ = "user"
__version__ = "2024.03.09"

import rhinoscriptsyntax as rs

params = x
# ---------- end ghpython_script_3 ----------
data_6 = Data(list_item_2)
data_7 = Data(ghpython_script_3.params)
list_item_4 = ListItem(List=data_7, Index=0, Wrap=True)  # -> Item, Item1, Item2, Item3, Item4, Item5
id_experiment = Panel(data_5)
iteration = Panel(data_6)
panel_13 = Panel(integer_4)
number_of_experiments = Panel(integer)
total_iterations = Panel(integer_5)
move = Move(Geometry=graft(curve_5), Motion=unit_x)  # -> flatten(Geometry), Transform
# Cross Section
integer_6 = Integer(list_item_4.Item5)
# Starting Design
integer_7 = Integer(list_item_4.Item4)
path = Path(integer_7)
tree_branch = TreeBranch(Tree=entwine, Path=path, MaintainPaths=True)
point_4 = Point(tree_branch)
# Selection: Attribute
integer_8 = Integer(list_item_4.Item)
# Design Operation
integer_9 = Integer(list_item_4.Item3)
# Selection: Percentage
num_4 = Number(list_item_4.Item2)
# Selection: Strategy
integer_10 = Integer(list_item_4.Item1)
currrent_experiment_parameters = Panel(data_7)
panel_14 = Panel(integer_3)
srf_4 = Surface(move.Geometry)
integer_11 = Integer(integer_7)
srf_5 = Surface(curve_4)
srf_6 = Surface(srf_4)
filter = StreamFilter(Gate=integer_11, Stream0=srf_5, Stream1=srf_6, Stream2=srf_6, Stream3=srf, Stream4=srf_2, Stream5=srf_3)
curve_6 = Curve(filter)
curve_7 = Curve(curve_6)
number_slider_5 = Slider(0, range=0..1)
data_8 = Data(data_6)
data_9 = Data(data_8)
srf_7 = Surface(curve_7)
data_10 = Data(data_4)
py3 = Python3Script(data_0=srf_7, n_iter=data_10, iter=data_9, reset=Button())  # -> out, iter, data; inputs data_0: list, n_iter: Int32, iter: Int32
# ---------- py3: Python ----------
__author__ = "tamk"
__version__ = "2024.03.21"

import rhinoscriptsyntax as rs
from scriptcontext import sticky
from copy import deepcopy

if reset or 'logger' not in sticky:
    sticky['logger'] = {}

if iter_ == 0:
    data = sticky['logger'][0] = data_0
else:
    data = sticky['logger'][iter_]
# ---------- end py3 ----------
panel_15 = Panel(py3.out)
data_11 = Data(py3.data)
data_12 = Data(py3.iter)
data_13 = Data(data_11)
integer_12 = Integer(integer_8)
# RULE-BASED DESIGN SYSTEM COMPONENTS
# SELECTION ATTRIBUTE
selection_rule = Panel(integer_12)
stream_gate = StreamGate(Stream=data_13, Gate=integer_12)  # -> Target0, Target1, Target2
data_14 = Data(stream_gate.Target0)
# Face Areas
srf_8 = Surface(data_14)
area = Area(Geometry=srf_8)  # -> Area, Centroid
data_15 = Data(area.Area)
data_16 = Data(data_15)
integer_13 = Integer(integer_12)
stream_filter_2 = StreamFilter(Gate=integer_13, Stream0=data_16)
data_17 = Data(data_14)
data_18 = Data(stream_filter_2)
entwine_2 = Entwine(Branch00=data_18, Branch01=data_17, FlattenInputs=True)
data_19 = Data(entwine_2)
# SELECTION METHOD
integer_14 = Integer(integer_10)
integer_15 = Integer(integer_14)
data_20 = Data(data_19)
stream_gate_2 = StreamGate(Stream=data_20, Gate=integer_15)  # -> Target0, Target1, Target2, Target3
# Select Top Ranked Faces
data_21 = Data(stream_gate_2.Target1)
# Select All Faces
data_22 = Data(stream_gate_2.Target0)
explode_tree = ExplodeTree(Data=data_21)  # -> Branch0, Branch1
explode_tree_2 = ExplodeTree(Data=data_22)  # -> Branch0, Branch1
num_5 = Number(num_4)
data_23 = Data(explode_tree.Branch0)
data_24 = Data(explode_tree_2.Branch1)
data_25 = Data(explode_tree.Branch1)
list_length_3 = ListLength(List=data_25)
multiplication = Multiplication(A=list_length_3, B=num_5)
sort_list = SortList(Keys=data_23, ValuesValuesA=data_25)  # -> Keys, reverse(ValuesValuesA)
round = Round(Number=multiplication)  # -> Nearest, Floor, Ceiling
integer_16 = Integer(round.Ceiling)
data_26 = Data(sort_list.ValuesValuesA)
ghpython_script_4 = GhPythonScript(list=data_26, k=integer_16)  # -> out, list_1, list_2; inputs list: list
# ---------- ghpython_script_4: Python ----------
__author__ = "user"
__version__ = "2024.03.09"

import rhinoscriptsyntax as rs

n = len(list)

list_1=list[k:]
list_2=list[:k]
# ---------- end ghpython_script_4 ----------
data_27 = Data(ghpython_script_4.list_1)
data_28 = Data(ghpython_script_4.list_2)
data_29 = Data(data_24)
entwine_3 = Entwine(Branch00=data_27, Branch01=data_28, FlattenInputs=True)  # -> simplify(Result)
entwine_4 = Entwine(Branch01=data_29, FlattenInputs=True)  # -> simplify(Result)
integer_17 = Integer(integer_14)
stream_filter_3 = StreamFilter(Gate=integer_17, Stream0=entwine_4, Stream1=entwine_3)
explode_tree_3 = ExplodeTree(Data=stream_filter_3)  # -> Branch0, Branch1
data_30 = Data(explode_tree_3.Branch0)
data_31 = Data(explode_tree_3.Branch1)
# DESIGN OPERATION
data_32 = Data(data_31)
integer_18 = Integer(integer_9)
stream_gate_3 = StreamGate(Stream=data_32, Gate=integer_18)  # -> Target0, Target1, Target2, Target3
data_33 = Data(stream_gate_3.Target0)
data_34 = Data(stream_gate_3.Target1)
# Ice Ray Lattice
data_35 = Data(data_33)
number_5 = Number(num)
data_36 = Data(data_34)

# ---- group: Generic Rule
quad_double_split = QuadDoubleSplit(data=data_35, number=number_5)

# ---- group: 规则2
generic_rule2 = GenericRule2(brep=data_36)

# ----
crv = Curve(data_32)
srf_9 = Surface(quad_double_split)
surface = Surface(generic_rule2)
previewlw = CustomPreviewLineweights(Geometry=crv, Shader=ColourSwatch(SwatchColor=RGB(204, 0, 0)), Thickness=Slider(20, range=0..100), Absolute=False)
srf_10 = Surface(surface)
srf_11 = Surface(srf_9)
integer_19 = Integer(integer_18)
stream_filter_4 = StreamFilter(Gate=integer_19, Stream0=srf_11, Stream1=srf_10)
surface_2 = Surface(stream_filter_4)
surface_3 = Surface(data_30)
merge = Merge(Data1=flatten(surface_3), Data2=flatten(surface_2))
num_6 = Number(num)
integer_20 = Integer(integer_6)
num_7 = Number(num_2)
data_37 = Data(point_4)
data_38 = Data(merge)
py3_2 = Python3Script(x=data_38)  # -> out, a; inputs x: list
# ---------- py3_2: Python ----------
"""Grasshopper Script"""
a = "Hello Python 3 in Grasshopper!"
print(a)


from scriptcontext import sticky

print( sticky.get('logger', {}))
# ---------- end py3_2 ----------
data_39 = Data(data_12)
py3_3 = Python3Script(data_1=data_38, iter=data_39, log_hist=Toggle(True))  # -> out, data_1, hist; inputs data_1: list of GeometryBase, iter: Int32
# ---------- py3_3: Python ----------
"""Grasshopper Script"""
a = "Hello Python 3 in Grasshopper!"


import rhinoscriptsyntax as rs

from scriptcontext import sticky

_hist = sticky.get('logger', {})

_hist[iter_ + 1] = data_1
if not log_hist and iter_ in _hist:
    _hist.pop(iter_)

hist = [_hist]

print(data_1)
# ---------- end py3_3 ----------
panel_16 = Panel(py3_3.out)
crv_2 = Curve(merge)
crv_3 = Curve(surface_2)
previewlw_2 = CustomPreviewLineweights(Geometry=crv_3, Shader=ColourSwatch(SwatchColor=RGB(143, 73, 105)), Thickness=Slider(13, range=0..100), Absolute=False)
previewlw_3 = CustomPreviewLineweights(Geometry=crv_2, Shader=ColourSwatch(SwatchColor=RGB(204, 204, 204)), Thickness=Slider(2, range=0..10), Absolute=False)
# SAVE DATA
integer_21 = Integer(data_5)
integer_22 = Integer(data_6)
number_6 = Number(integer_8)
number_7 = Number(integer_10)
number_8 = Number(integer_9)
number_9 = Number(num_4)
number_10 = Number(integer_6)
number_11 = Number(integer_7)

# ---- group: record this with colibri / output data for experiment e iteration k
data_40 = Data(py3_3.data_1)

# ----
# ANALYSIS
srf_12 = Surface(data_40)
cluster = Cluster(data=srf_12, relay=num_7, joint_points=data_37, relay_3=integer_20, relay_2=num_6)  # -> model_karamba3d_8, s_0, displacement_cm, energy_kn_m, curve_2, pts
number_12 = Number(cluster.energy_kn_m)
num_8 = Number(cluster.s_0)
num_9 = Number(cluster.displacement_cm)
model_karamba3d = ModelKaramba3D(cluster.model_karamba3d_8)
number_13 = Number(number_12)
number_14 = Number(num_9)
num_10 = Number(num_8)
strain_energy = Panel(number_13)
max_disp = Panel(number_14)
mass = Panel(num_10)
model_karamba3d_2 = ModelKaramba3D(model_karamba3d)
model_karamba3d_3 = ModelKaramba3D(model_karamba3d_2)
model_karamba3d_4 = ModelKaramba3D(model_karamba3d_2)
# EXTRACT RESULTS
disassemble = DisassembleModelKaramba3D(Model=model_karamba3d_3)  # -> Model, Point, Beam, Shell, Support, Load, Line, Mesh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
utilization = UtilizationOfElementsKaramba3D(
    AnalysedModel=model_karamba3d_4,
    NumberOfSamplePoints=3,
    ElasticDesign=True,
    GammaM0=1,
    GammaM1=1.1,
    SwayFrame=True,
    WithDetails=False,
    mode="Beams")  # -> Model, Utilization, SigMax_kN_cm², SigMin_kN_cm², TauMax_kN_cm², UtilN, UtilVy, UtilVz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

# ---- group: record this with colibri / experiment e
data_41 = Data(data_5)

# ---- group: record this with colibri / experiment e iteration k
iteration_2 = Data(data_12)

# ----
number_15 = Number(mass)
number_16 = Number(max_disp)
number_17 = Number(strain_energy)
element_karamba3d = ElementKaramba3D(disassemble.Beam)
panel_17 = Panel("""ep
iter
selection_att
selection_str
Select_percent
Design_rule
Starting_case
Crossec_opt""")
panel_18 = Panel("""mass
max_disp
strain_ener
max_util""")
num_11 = Number(utilization.Utilization)
disassemble_2 = DisassembleElementKaramba3D(Element=element_karamba3d)  # -> Element, ElementIdentifier, AxisOfElement, CrossSection, Joint, Material, LocalCoordinateSystem, ElementIsActive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
merge_2 = Merge(
    Data1=integer_21,
    Data2=integer_22,
    Data3=number_6,
    Data4=number_7,
    Data5=number_9,
    Data6=number_8,
    Data7=number_11,
    Data8=number_10)  # -> flatten(Result)
panel_19 = Panel(", out:")
panel_20 = Panel(", in:")
num_12 = Number(flatten(num_11))
cross_section_karamba3d = CrossSectionKaramba3D(disassemble_2.CrossSection)
merge_3 = Merge(Data1=panel_17, Data2=panel_18)
data_42 = Data()
data_43 = Data()
sort = SortList(Keys=num_12)  # -> Keys, ValuesA
disassemble_3 = DisassembleCrossSectionKaramba3D(CroSec=cross_section_karamba3d)  # -> CrossSection, FamilyNameOfCrossSection, TypeNameOfCrossSection, ElemIdentifiers, Colour, Material, LocalEccentricity_cm, simplify(Heights_cm)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
construct_point = ConstructPoint(XCoordinate=0, YCoordinate=Slider(-2, range=-10..10), ZCoordinate=0)
concatenate = Concatenate(FragmentH="exp: ", FragmentA=data_41, FragmentI=", iter:", FragmentC=iteration_2)
num_13 = Number(flatten(sort.Keys))
num_14 = Number(flatten(num_13))
sort_2 = SortList(Keys=num_14)  # -> reverse(Keys), ValuesA
item = ListItem(List=sort_2.Keys, Index=0, Wrap=True)
number_18 = Number(item)
number_19 = Number(number_18)
max_utilisation = Panel(number_19)
number_20 = Number(max_utilisation)
merge_4 = Merge(Data1=number_15, Data2=number_16, Data3=number_17, Data4=number_20)  # -> flatten(Result)
merge_5 = Merge(Data1=merge_2, Data2=merge_4)
text_tag_3d = TextTag3D(Location=construct_point, Text=concatenate, Size=Slider(0.5, range=0..1), Justification=7)
panel_21 = Panel(merge_3)
model_karamba3d_5 = ModelKaramba3D(model_karamba3d_2)
modelview = ModelViewKaramba3D(Model=model_karamba3d_5)  # -> Model, DeformedMesh, DeformedAxes, DeformedModel, MaximumDeformation
bool_2 = Boolean(bool)
txt_2 = Text(txt)
data_44 = Data(reset)
ghpython_script_5 = GhPythonScript(filepath=txt_2, head=panel_21, data=merge_5, write=bool_2, reset=data_44)  # -> out, a; inputs head: list, data: list
# ---------- ghpython_script_5: Python ----------
__author__ = "tamk"
__version__ = "2024.04.04"

import rhinoscriptsyntax as rs
from scriptcontext import sticky
import os
import sys


if reset:
    _ = sticky.pop('filestream', {})
    
fs = sticky.setdefault('filestream', None)

if not fs and filepath and write:
    fs = sticky['filestream'] = open(filepath, 'w')
    if head:
        fs.write(','.join(str(_h) for _h in head) + '\n')
    
if fs and write:
    fs.write(','.join(str(_x) for _x in data) + '\n')
    fs.flush()

if fs and not write:
    fs.close()
    fs = sticky['filestream'] = None
# ---------- end ghpython_script_5 ----------
panel_22 = Panel(txt_2)
beamview = BeamViewKaramba3D(Model=modelview.Model)  # -> Model, MeshesOfRenderedBeams, DeformedBeamAxes, LegendColours, LegendTags
legend = Legend(Colour=beamview.LegendColours, Tags=beamview.LegendTags, LegendType=101)

# ==== cluster QuadDoubleSplit
data = ClusterInput()
# 2 curve at once selection
number = ClusterInput()
data_2 = Data(data)
number_2 = Number(number)
deconstruct_brep = DeconstructBrep(Brep=data_2)  # -> simplify(Faces), Edges, flatten(Vertices)
join_curves = JoinCurves(Curves=deconstruct_brep.Edges, Preserve=False)  # -> simplify(Curves)
reduce = Reduce(Polyline=join_curves, Tolerance=number_2)  # -> Polyline, Reduction
explode = Explode(Curve=reduce.Polyline, Recursive=True)  # -> simplify(Segments), Vertices
length = Length(Curve=explode.Segments)
sort_list = SortList(Keys=length, ValuesValuesA=explode.Segments)  # -> Keys, ValuesValuesA
list_item = ListItem(List=sort_list.ValuesValuesA, Index="-1", Wrap=True)
item_index = ItemIndex(List=explode.Segments, Item=list_item)
addition = Addition(A=item_index, B=2)
list_item_2 = ListItem(List=explode.Segments, Index=addition, Wrap=True)
evaluate_length = EvaluateLength(Curve=list_item, Length=Slider(0.333, range=0..1), Normalized=True)  # -> Point, Tangent, Parameter
evaluate_length_2 = EvaluateLength(Curve=list_item_2, Length=Slider(0.667, range=0..1), Normalized=True)  # -> Point, Tangent, Parameter
construct_domain = ConstructDomain(DomainStart=Slider(0.1, range=0..0.1), DomainEnd=Slider(0.9, range=0..1))
line = Line(StartPoint=evaluate_length.Point, EndPoint=evaluate_length_2.Point)
random = Random(Range=construct_domain, Number=1, Seed=2)
project = Project(Curve=line, Brep=deconstruct_brep.Faces, Direction=Vector(0, 0, 1))
item_index_2 = ItemIndex(List=explode.Segments, Item=list_item)
addition_2 = Addition(A=item_index_2, B=1)
evaluate_curve = EvaluateCurve(Curve=reparameterize(project), Parameter=random)  # -> Point, Tangent, Angle
list_item_3 = ListItem(List=explode.Segments, Index=addition_2, Wrap=True)
subtraction = Subtraction(A=1, B=random)
evaluate_curve_2 = EvaluateCurve(Curve=reparameterize(list_item_3), Parameter=subtraction)  # -> Point, Tangent, Angle
line_2 = Line(StartPoint=evaluate_curve.Point, EndPoint=evaluate_curve_2.Point)
surface_split = SurfaceSplit(Surface=deconstruct_brep.Faces, Curves=flatten([project, line_2]))  # -> simplify(flatten(Fragments))
fragments = ClusterOutput(surface_split)

# ==== cluster Cluster
data = ClusterInput()
data_2 = Data(data)
joint_points = ClusterInput()  # joint points
relay = ClusterInput()
brep_edges = BrepEdges(Brep=data_2)  # -> flatten(Naked), Interior, NonManifold
relay_2 = ClusterInput()
relay_3 = ClusterInput()
num = Number(relay)
num_2 = Number(relay_2)
llinter = LineLineIntersectionKaramba3D(Line=brep_edges.Naked, LimitDistance_m=0.005)  # -> IntersectionPoints, flatten(LineSubSegements)
removeduplicatelines = RemoveDuplicateLines(Lines=llinter.LineSubSegements, Tolerance=0.01)
data_3 = Data(removeduplicatelines)
# This is to find the top chord
# to apply line load to
data_4 = Data(data_3)
end_points = EndPoints(Curve=data_4)  # -> Start, End
point = Point(end_points.Start)
point_2 = Point(end_points.End)
deconstruct = Deconstruct(Point=point_2)  # -> XComponent, YComponent, ZComponent
deconstruct_2 = Deconstruct(Point=point)  # -> XComponent, YComponent, ZComponent
num_3 = Number(num)
larger_than = LargerThan(FirstNumber=deconstruct_2.YComponent, SecondNumber=Slider(3.229, range=0..10))  # -> LargerThan, OrEqualTo
length = Length(Curve=removeduplicatelines)
equality_within_tolerance = EqualityWithinTolerance(FirstNumber=deconstruct_2.YComponent, SecondNumber=deconstruct.YComponent, Tolerance=Slider(0.01, range=0..0.01))  # -> Equality, Inequality
mass_addition = MassAddition(Input=length)  # -> Result, PartialResults
pi = Pi(Factor=1)
gate_and = GateAnd(A=equality_within_tolerance.Equality, B=larger_than.LargerThan)
division = Division(A=num_3, B=mass_addition.Result)
dispatch = Dispatch(List=removeduplicatelines, DispatchPattern=gate_and)  # -> ListA, ListB
division_2 = Division(A=division, B=pi)
square_root = SquareRoot(Value=division_2)
num_4 = Number(num_2)
line = Line(dispatch.ListA)
list_length = ListLength(List=line)
entwine = Entwine(Branch00=dispatch.ListA, Branch01=dispatch.ListB, FlattenInputs=True)  # -> flatten(Result)
list_length_2 = ListLength(List=entwine)
series = Series(Start=0, Step=1, Count=list_length_2)
concatenate = Concatenate(FragmentA="BEAM", FragmentB=series)
split_list = SplitList(List=concatenate, Index=list_length)  # -> ListA, ListB
addition = Addition(A="2", B=num_4)
multiplication = Multiplication(A=square_root, B=200)
division_3 = Division(A=multiplication, B=addition)
num_5 = Number(multiplication)
num_6 = Number(division_3)
crosec = CrossSectionKaramba3D(FamilyNameOfCrossSection="DefaultCroSec", Diameter_cm=num_5, WallThickness_cm=num_6, mode="Circular Hollow")
curve = Curve(entwine)
linetobeam = LineToBeamKaramba3D(
    Line=curve,
    Identifier=concatenate,
    CrossSection=crosec,
    New=True,
    Remove=True,
    LimitDistance_m=0.005,
    Bending=True,
    SetBucklingLength=True,
    ToPolylineMaxAngle=0.03,
    ToPolylineTolerance=0.01,
    ToPolylineMaxEdgeLength=0.25)  # -> Element, Points, Info
removeduplicatepts = RemoveDuplicatePts(Points=joint_points, Tolerance=num_2)
unit_y = UnitY(Factor=Slider(2, range=0..1000))
data_5 = Data(split_list.ListA)
pt = Point(removeduplicatepts)
point_3 = Point(linetobeam.Points)
supp = SupportKaramba3D(PosInd=pt, menu=[buttons(on, on, off, on, on, on)])
supp_2 = SupportKaramba3D(PosInd=point_3, menu=[buttons(off, off, on, off, off, off)])
loads = LoadsKaramba3D(Vector=Vector(0, 0, -1), LCase="LC0", mode="Gravity")
beam_loads = BeamLoadsKaramba3D(BeamIdentifier=data_5, LoadCase="LC0", ForceVector=unit_y, TPosition=0.5, mode="Concentrated", menu=[buttons(on, off)])
load_karamba3d = LoadKaramba3D(flatten(beam_loads))
limit_distance_m = LimitDistanceM(num_2)
assemble = AssembleModelKaramba3D(
    Elem=flatten(linetobeam.Element),
    Support=flatten([supp, supp_2]),
    Load=flatten([load_karamba3d, loads]),
    LimitDistance_m=flatten(limit_distance_m))  # -> Model, Info, Mass_kg, CentreOfGravity, LoadCaseNames
number = Number(assemble.Mass_kg)
analyse = AnalyseKaramba3D(Model=assemble.Model)  # -> AnalysedModel, MaximumDisplacement_cm, ResultingForce_kN, ChangeOfElasticEnergy_kNm
model_karamba3d = ModelKaramba3D(analyse.AnalysedModel)
number_2 = Number(analyse.MaximumDisplacement_cm)
number_3 = Number(analyse.ChangeOfElasticEnergy_kNm)
# Create Cross Sections
number_slider = Slider(0.5, range=0..10)
number_4 = Number(Slider(30, range=0..100))
integer = Integer(Slider(30, range=0..100))
number_5 = Number(number_slider)
construct_domain = ConstructDomain(DomainStart=number_5, DomainEnd=number_4)
range = Range(Domain=construct_domain, Steps=integer)
number_6 = Number(range)
integer_2 = Integer(relay_3)
model_karamba3d_2 = ModelKaramba3D(model_karamba3d)
concatenate_2 = Concatenate(FragmentA="circle_solid_", FragmentB=number_6)
stream_gate = StreamGate(Stream=model_karamba3d_2, Gate=integer_2)  # -> Target0, Target1
number_7 = Number(number_6)
model_karamba3d_3 = ModelKaramba3D(stream_gate.Target0)
model_karamba3d_4 = ModelKaramba3D(stream_gate.Target1)
# OPTIMISE
# Cross Section Optimisation
crosec_2 = CrossSectionKaramba3D(
    FamilyNameOfCrossSection="DefaultCroSec",
    NameOfCrossSection=concatenate_2,
    Diameter_cm=number_7,
    WallThickness_cm=expr("x/2", number_7),
    mode="Circular Hollow")
number_8 = Number(Slider(1, range=0..1))
number_9 = Number(number_8)
model_karamba3d_5 = ModelKaramba3D(model_karamba3d_4)
cross_sections = CrossSections(crosec_2)
opticrosec = OptimizeCrossSectionKaramba3D(
    Model=model_karamba3d_5,
    CrossSections=cross_sections,
    MaximumUtilization=number_9,
    MaximumDisplacement_cm=-1,
    MaximumVirtualWork_kNcm=0.01,
    NumberOfUtilizationIterations=5,
    NumberOfDisplacementIterations=5,
    NumberOfDisplacementIncrementsPerIteration=2,
    DisplacementTolerance=0.01,
    NumberOfSamplePoints=3,
    ElasticDesign=True,
    GammaM0=1,
    GammaM1=1.1,
    SwayFrame=True)  # -> OptimizedModel, Info, Mass_kg, MaximumDisplacement_cm, ElasticEnergyChange_kNm, MaximumUtilizationViewInsufficientCrossSections, MaximumDisplacementViewLimitCrossSections
model_karamba3d_6 = ModelKaramba3D(opticrosec.OptimizedModel)
number_10 = Number(opticrosec.Mass_kg)
number_11 = Number(number)
number_12 = Number(number_10)
_0 = Stream0(model_karamba3d_3)
_0_2 = Stream0(model_karamba3d_6)
integer_3 = Integer(relay_3)
stream_filter = StreamFilter(Gate=integer_3, Stream0=_0, Stream1=_0_2)
_0_3 = Stream0(number_11)
_0_4 = Stream0(number_12)
integer_4 = Integer(relay_3)
stream_filter_2 = StreamFilter(Gate=integer_4, Stream0=_0_3, Stream1=_0_4)
_0_5 = Stream0(stream_filter)
curve_2 = ClusterOutput(curve)
pts = ClusterOutput(linetobeam.Points)
model_karamba3d_7 = ModelKaramba3D(_0_5)
energy_kn_m = ClusterOutput(number_3)
displacement_cm = ClusterOutput(number_2)
s_0 = ClusterOutput(stream_filter_2)
model_karamba3d_8 = ClusterOutput(model_karamba3d_7)

# ==== cluster GenericRule2
brep = ClusterInput()
deconstruct_brep = DeconstructBrep(Brep=brep)  # -> Faces, Edges, flatten(Vertices)
join_curves = JoinCurves(Curves=deconstruct_brep.Edges, Preserve=False)
explode = Explode(Curve=join_curves, Recursive=True)  # -> Segments, Vertices
number_slider = Slider(0.333, range=0..1)
length = Length(Curve=explode.Segments)
sort_list = SortList(Keys=length, ValuesValuesA=explode.Segments)  # -> Keys, ValuesValuesA
list_item = ListItem(List=sort_list.ValuesValuesA, Index="-1", Wrap=True)
item_index = ItemIndex(List=explode.Segments, Item=list_item)
addition = Addition(A=item_index, B=2)
list_item_2 = ListItem(List=explode.Segments, Index=addition, Wrap=True)
evaluate_length = EvaluateLength(Curve=list_item, Length=number_slider, Normalized=True)  # -> Point, Tangent, Parameter
evaluate_length_2 = EvaluateLength(Curve=list_item_2, Length=number_slider, Normalized=True)  # -> Point, Tangent, Parameter
line = Line(StartPoint=evaluate_length.Point, EndPoint=evaluate_length_2.Point)
project = Project(Curve=line, Brep=deconstruct_brep.Faces, Direction=Vector(0, 0, 1))
surface_split = SurfaceSplit(Surface=deconstruct_brep.Faces, Curves=project)  # -> simplify(flatten(Fragments))
fragments = ClusterOutput(surface_split)
