# Grasshopper definition build_curved_volume.gh (Grasshopper 1.0.8)

# VARIABLES
number_slider = Slider(10, range=0..20)
number = Number(Slider(1.31, range=0..5))
number_2 = Number(Slider(2.13, range=0..5))
number_3 = Number(Slider(1.95, range=0..5))
number_4 = Number(Slider(2.37, range=0..5))
number_5 = Number(Slider(1.89, range=0..5))
number_6 = Number(Slider(0.65, range=0..5))
number_7 = Number(number_slider)
number_8 = Number(Slider(10, range=0..10))
number_9 = Number(Slider(3, range=0..10))
number_10 = Number(Slider(2, range=0..10))
number_11 = Number(Slider(1.04, range=0..10))
number_12 = Number(Slider(2.33, range=0..10))
number_13 = Number(Slider(0.66, range=0..10))
number_14 = Number(Slider(0.37, range=0..10))
construct_domain = ConstructDomain(DomainStart=0, DomainEnd=number_8)
range = Range(Domain=construct_domain, Steps=Slider(10, range=0..10))
construct_point = ConstructPoint(XCoordinate=0, YCoordinate=0, ZCoordinate=expr("x/2", number_8))
construct_point_2 = ConstructPoint(XCoordinate=0, YCoordinate=0, ZCoordinate=0)
construct_point_3 = ConstructPoint(XCoordinate=0, YCoordinate=0, ZCoordinate=number_8)
point = Point(construct_point_3)
point_2 = Point(construct_point_2)
point_3 = Point(construct_point)
merge = Merge(Data1=number_12, Data2=number_14, Data3=number_13)
merge_2 = Merge(Data1=number_9, Data2=number_11, Data3=number_10)
merge_3 = Merge(Data1=point_2, Data2=point_3, Data3=point)
construct_point_4 = ConstructPoint(XCoordinate=0, YCoordinate=0, ZCoordinate=expr("x/2", number_7))
# PIPELINE
# BUILD GEOMETRIES
construct_point_5 = ConstructPoint(XCoordinate=0, YCoordinate=0, ZCoordinate=0)
construct_point_6 = ConstructPoint(XCoordinate=0, YCoordinate=0, ZCoordinate=number_7)
panel = Panel("""0
45
90""")
circle = Circle(Plane=merge_3, Radius=merge_2)
point_4 = Point(merge_3)
e = Plane(point_4)
merge_4 = Merge(Data1=number, Data2=number_3, Data3=number_2)
merge_5 = Merge(Data1=number_4, Data2=number_6, Data3=number_5)
ellipse = Ellipse(Plane=e, Radius1=merge_2, Radius2=merge)  # -> Ellipse, Focus1, Focus2
integer = Integer(Slider(0, range=-180..180))
integer_2 = Integer(Slider(0, range=-180..180))
integer_3 = Integer(Slider(0, range=-180..180))
point_5 = Point(construct_point_5)
point_6 = Point(construct_point_6)
point_7 = Point(construct_point_4)
radians = Radians(Degrees=panel)
rotate = Rotate(Geometry=ellipse.Ellipse, Angle=radians, Plane=PlaneXY(0, 0, 0))  # -> Geometry, Transform
merge_6 = Merge(Data1=point_5, Data2=point_7, Data3=point_6)
merge_7 = Merge(Data1=integer, Data2=integer_2, Data3=integer_3)
number_15 = Number(Slider(10, range=0..10))
number_16 = Number(merge_4)
number_17 = Number(merge_5)
point_8 = Point(merge_6)
curve = Curve(ellipse.Ellipse)
curve_2 = Curve(rotate.Geometry)
circle_2 = Circle(Plane=point_8, Radius=number_17)
curve_3 = Curve(circle)
radians_2 = Radians(Degrees=merge_7)
ellipse_2 = Ellipse(Plane=point_8, Radius1=number_17, Radius2=number_16)  # -> Ellipse, Focus1, Focus2
curve_4 = Curve(ellipse_2.Ellipse)
loft = Loft(Curves=curve, Options={Adjust=False, Closed=False, LoftEnds=0, LoftSimp=0, LoftType=0, Rebuild=10, Refit=0.01})
loft_2 = Loft(Curves=curve_2, Options={Adjust=False, Closed=False, LoftEnds=0, LoftSimp=0, LoftType=0, Rebuild=10, Refit=0.01})
loft_3 = Loft(Curves=curve_3, Options={Adjust=False, Closed=False, LoftEnds=0, LoftSimp=0, LoftType=0, Rebuild=10, Refit=0.01})
surface = Surface(loft)
surface_2 = Surface(loft_2)
contour = Contour(Shape=surface_2, Point=Point(0, 0, 0), Direction=Vector(0, 0, 1), Distance=Slider(1, range=0..10))
curve_5 = Curve(contour)
divide_curve = DivideCurve(Curve=curve_5, Count=number_15, Kinks=False)  # -> Points, Tangents, Parameters
flip_matrix = FlipMatrix(Data=divide_curve.Points)
interpolate = Interpolate(Vertices=divide_curve.Points, Degree=Toggle(True), Periodic=False, KnotStyle=1)  # -> Curve, Length, Domain
interpolate_2 = Interpolate(Vertices=flip_matrix, Degree=3, Periodic=False, KnotStyle=1)  # -> Curve, Length, Domain
rotate_2 = Rotate(Geometry=curve_4, Angle=radians_2, Plane=PlaneXY(0, 0, 0))  # -> Geometry, Transform
surface_3 = Surface(loft_3)
curve_6 = Curve(interpolate.Curve)
surface_4 = Surface(contour)
curve_7 = Curve(interpolate_2.Curve)
custom_preview = CustomPreview(Geometry=surface_4, Material=ColourSwatch(SwatchColor=RGB(0, 0, 0)))
curve_8 = Curve(circle_2)
pipe = Pipe(Curve=curve_7, Radius=Slider(0.05, range=0..1), Caps=0)
curve_9 = Curve(rotate_2.Geometry)
loft_4 = Loft(Curves=curve_8, Options={Adjust=False, Closed=False, LoftEnds=0, LoftSimp=0, LoftType=0, Rebuild=10, Refit=0.01})
loft_5 = Loft(Curves=curve_9, Options={Adjust=False, Closed=False, LoftEnds=0, LoftSimp=0, LoftType=0, Rebuild=10, Refit=0.01})
surface_5 = Surface(loft_4)
number_18 = Number("1")
surface_6 = Surface(loft_5)
contour_2 = Contour(Shape=surface_6, Point=Point(0, 0, 0), Direction=Vector(0, 0, 1), Distance=number_18)
curve_10 = Curve(contour_2)
integer_4 = Integer(Slider(10, range=0..20))
divide_curve_2 = DivideCurve(Curve=curve_10, Count=integer_4, Kinks=False)  # -> Points, Tangents, Parameters
boundary_surfaces = BoundarySurfaces(Edges=curve_10)
panel_2 = Panel(divide_curve_2.Points)
point_9 = Point(simplify(divide_curve_2.Points))
surface_7 = Surface(boundary_surfaces)
flip_matrix_2 = FlipMatrix(Data=point_9)
interpolate_3 = Interpolate(Vertices=flip_matrix_2, Degree=3, Periodic=False, KnotStyle=1)  # -> Curve, Length, Domain
pipe_2 = Pipe(Curve=interpolate_3.Curve, Radius=Slider(0.2, range=0..1), Caps=0)
