# Grasshopper definition build_spaceframe.gh (Grasshopper 1.0.8)
# plug-ins: Karamba3D, LunchBox

# ----
# Size (side-length) of space frame-defining surface.
number_slider = Slider(6, range=0..20)
data = Data(number_slider)
dom = ConstructDomain(DomainStart=expr("-x", data), DomainEnd=data)
domain = Domain(dom)

# ----
# INITIALISE MODEL
# Define centre point of model.
panel = Panel("0.0")
pt = ConstructPoint(XCoordinate=panel, YCoordinate=panel, ZCoordinate=panel)
pt_2 = Point(pt)
xy = XYPlane(Origin=pt_2)
pln = Plane(xy)

# ----
# Make rectangular surface.
rectangle = Rectangle(Plane=pln, XSize=domain, YSize=domain, Radius=0)  # -> Rectangle, Length
boundary = BoundarySurfaces(Edges=rectangle.Rectangle)
srf = Surface(boundary)

# ----
# ORIGINAL SURFACES
# Move ground surface up to generate base surface.
number_slider_2 = Slider(4.8, range=0..10)
Z = UnitZ(Factor=number_slider_2)
data_2 = Data(Z)
move = Move(Geometry=srf, Motion=data_2)  # -> Geometry, Transform
srf_2 = Surface(move.Geometry)

u_divisions_truss = Slider(3, range=0..10)
int = Integer(u_divisions_truss)
srf_3 = Surface(srf_2)
U = UDivisions(int)
grid = GridStructure(Surface=srf_3, UDivisions=U, VDivisions=U)  # -> StructureLines, StructureNodes
pt_3 = Point(grid.StructureNodes)

# ----
# Define bottom surface's heights
number_slider_3 = Slider(5, range=0..10)
# MODIFY SURFACES
number_slider_4 = Slider(0.251, range=-1..1)
merge = Merge(
    Data1=number_slider_4,
    Data2=Slider(0, range=-1..1),
    Data3=Slider(0, range=-1..1),
    Data4=Slider(0, range=-1..1),
    Data5=Slider(-0.027, range=-1..1),
    Data6=Slider(0, range=-1..1),
    Data7=Slider(-0.032, range=-1..1),
    Data8=Slider(0, range=-1..1),
    Data9=Slider(0, range=-1..1))
number = Number(number_slider_3)
number_2 = Number(merge)
multiplication = Multiplication(A=number_2, B=number)
number_3 = Number(multiplication)

# ----
# Define bottom surface's heights
number_4 = Number(number_3)
merge_2 = Merge(
    Data1=Slider(1, range=-1..1),
    Data2=Slider(0, range=-1..1),
    Data3=Slider(0, range=-1..1),
    Data4=Slider(0.336, range=-1..1),
    Data5=Slider(0.428, range=-1..1),
    Data6=Slider(0, range=-1..1),
    Data7=Slider(0, range=-1..1),
    Data8=Slider(0, range=-1..1),
    Data9=Slider(0, range=-1..1))
number_5 = Number(Slider(1, range=0..10))
number_6 = Number(Slider(1.2, range=0..10))
number_7 = Number(merge_2)
multiplication_2 = Multiplication(A=number_7, B=number_5)
number_8 = Number(multiplication_2)
addition = Addition(A=number_8, B=number_6)
addition_2 = Addition(A=number_4, B=addition)
num = Number(addition_2)

point = Point(pt_3)
U_2 = UCount(int)
boolean_toggle = BooleanToggle(True)

point_2 = Point(point)
num_2 = Number(number_3)
U_3 = UCount(U_2)
unit_z = UnitZ(Factor=num_2)
vector = Vector(unit_z)
move_2 = Move(Geometry=point_2, Motion=vector)  # -> Geometry, Transform
point_3 = Point(move_2.Geometry)
surface_from_points = SurfaceFromPoints(Points=point_3, UCount=expr("x+1", U_3), Interpolate=boolean_toggle)
# GENERATE FRAME STRUCTURE
surface = Surface(surface_from_points)

point_4 = Point(point)
U_4 = UCount(U_2)
num_3 = Number(num)
unit_z_2 = UnitZ(Factor=num_3)
vector_2 = Vector(unit_z_2)
move_3 = Move(Geometry=point_4, Motion=vector_2)  # -> Geometry, Transform
point_5 = Point(move_3.Geometry)
surface_from_points_2 = SurfaceFromPoints(Points=point_5, UCount=expr("x+1", U_4), Interpolate=boolean_toggle)
surface_2 = Surface(surface_from_points_2)

u_divisions_truss_2 = Slider(10, range=0..10)
v_divisions_truss = Slider(10, range=0..10)
# Generate space truss.
srf_4 = Surface(surface_2)
srf_5 = Surface(surface)
data_3 = Data(u_divisions_truss_2)
data_4 = Data(v_divisions_truss)
spacetruss_2 = SpaceTrussStructure2(SurfaceA=srf_4, SurfaceB=srf_5, UDivisions=data_3, VDivisions=data_4)  # -> LinesA, LinesB, Web, Nodes

space_truss = Line([spacetruss_2.LinesA, spacetruss_2.LinesB, spacetruss_2.Web])

# ----
# Parameterise ground surface to generate support locations.
srf_6 = Surface(reparameterize(srf))
merge_3 = Merge(
    Data1=Slider(0.15, range=0..1),
    Data2=Slider(0.2, range=0..1),
    Data3=Slider(0.9, range=0..1),
    Data4=Slider(0.75, range=0..1))
merge_4 = Merge(
    Data1=Slider(0.25, range=0..1),
    Data2=Slider(0.9, range=0..1),
    Data3=Slider(0.1, range=0..1),
    Data4=Slider(0.75, range=0..1))
pt_4 = ConstructPoint(XCoordinate=merge_3, YCoordinate=merge_4, ZCoordinate=0)
evalsrf = EvaluateSurface(Surface=srf_6, Point=pt_4)  # -> Point, Normal, UDirection, VDirection, Frame
pt_5 = Point(evalsrf.Point)

# ----
# Eligible nodes on base space frame layer to connect to support.
line = Line(spacetruss_2.LinesB)
end = EndPoints(Curve=line)  # -> Start, End
rdpoints = RemoveDuplicatePointsKaramba3D(Point=[end.Start, end.End], LimitDistance=0.005)  # -> OutPoint, Info, Indexes
pt_6 = Point(rdpoints.OutPoint)

pt_7 = Point(spacetruss_2.Nodes)

pt_8 = Point(pt_6)
pt_9 = Point(pt_5)
data_5 = Data(Slider(4, range=0..10))
cps = ClosestPoints(Point=pt_9, Cloud=pt_8, Count=data_5)  # -> simplify(ClosestPoint), CPIndex, Distance
graft = GraftTree(Tree=pt_9, IncludeEmptyLists=True, IncludeNullItems=True)  # -> simplify(Tree)
pt_10 = Point(graft)
pt_11 = Point(cps.ClosestPoint)

pt_12 = Point(pt_11)
pt_13 = Point(pt_10)
ln = Line(StartPoint=pt_12, EndPoint=pt_13)
space_truss_2 = Line(space_truss)
line_2 = Line(ln)

# ----
# ASSEMBLE
# ELEMENTS
pt_14 = Point(pt_7)
pt_15 = Point(pt_5)
merge_5 = Merge(Data1=line_2, Data2=space_truss_2)  # -> flatten(Result)
line_3 = Line(merge_5)

pt_16 = Point(pt_14)
Z_2 = UnitZ(Factor=1)
neg = Negative(Value=Z_2)
line_4 = Line(line_3)
loads = LoadsKaramba3D(ForceVector=neg, Local=False, PosInd=pt_16, LCase="LC0", mode="Point")
# STRUCTURAL
# ANALYSIS
supp = SupportKaramba3D(PosInd=pt_15, menu=[buttons(on, on, on, off, off, off)])
linetobeam = LineToBeamKaramba3D(
    Line=line_4,
    New=True,
    Remove=True,
    LimitDistance_m=0.005,
    Bending=True,
    SetBucklingLength=True,
    ToPolylineMaxAngle=0.03,
    ToPolylineTolerance=0.01,
    ToPolylineMaxEdgeLength=0.25)  # -> Element, Points, Info
assemble = AssembleModelKaramba3D(Elem=linetobeam.Element, Support=supp, Load=loads, LimitDistance_m=0.005)  # -> Model, Info, Mass_kg, CentreOfGravity, LoadCaseNames
analyze = AnalyzeKaramba3D(Model=assemble.Model)  # -> CalculatedModel, MaximumDisplacement_cm, ResultingForceOfGravity_kN, ElasticEnergyChange_kNm
model = ModelKaramba3D(analyze.CalculatedModel)

model_2 = ModelKaramba3D(model)
b_forces = BeamForcesKaramba3D(AnalysedModel=model_2, Ts=[0, 1])  # -> Model, NormalForce_kN, ShearForceVz_kN, ShearForceVy_kN, TorsionalMomentMt_kNm, BendingMomentMy_kNm, BendingMomentMz_kNm, LoadCaseIndex
num_4 = Number(b_forces.NormalForce_kN)
avr = Average(Input=num_4)
num_5 = Number(simplify(flatten(avr)))
abs = Absolute(Value=num_5)
num_6 = Number(abs)

number_slider_5 = Slider(0.02, range=0..0.1)  # disabled
number_slider_6 = Slider(0.2, range=0..1)  # disabled
# VISUALISE
line_5 = Line(line_3)  # disabled
num_7 = Number(num_6)  # disabled
num_8 = Number(number_slider_5)  # disabled
num_9 = Number(number_slider_6)  # disabled
sort = SortList(Keys=num_7)  # -> reverse(Keys), ValuesA; disabled
num_10 = Number(num_5)  # disabled
num_11 = Number(num_6)  # disabled
dom_2 = ConstructDomain(DomainStart=num_8, DomainEnd=num_9)  # disabled
item = ListItem(List=sort.Keys, Index=0, Wrap=True)  # disabled
num_12 = Number(item)  # disabled
num_13 = Number(num_12)  # disabled
dom_3 = ConstructDomain(DomainStart=0, DomainEnd=num_13)  # disabled
num_14 = Number(num_12)  # disabled
remap = RemapNumbers(Value=num_11, Source=dom_3, Target=dom_2)  # -> Mapped, Clipped; disabled
neg_2 = Negative(Value=num_14)  # disabled
num_15 = Number(remap.Mapped)  # disabled
gradient = Gradient(
    LowerLimit=neg_2,
    UpperLimit=num_14,
    Parameter=num_10,
    stops=[0: RGB(234, 38, 0), 0.25: RGB(234, 126, 0), 0.5: RGB(171, 169, 101), 0.75: RGB(173, 203, 249), 1: RGB(67, 117, 153)])  # disabled
R = Radius(num_15)  # disabled
C = Curve(line_5)  # disabled
pipe = Pipe(Curve=C, Radius=R, Caps=2)  # disabled
brep = Brep(pipe)  # disabled
M = Material(simplify(graft(gradient)))  # disabled
G = Geometry(brep)  # disabled
preview = CustomPreview(Geometry=G, Material=M)  # disabled
