# Grasshopper definition basic_truss_colibri.gh (Grasshopper 1.0.7)
# plug-ins: Karamba3D, CORE.Grasshopper.Colibri, Human

# Use Data Generator (True) or Sliders (False)
# INPUTS VARIABLES
# OPTION 1. PARAMETER AUTO-GENERATION
toggle = BooleanToggle(False)
# Start Data Recorder
toggle_2 = BooleanToggle(False)
int = Integer(Slider(10, range=0..10))
# OPTION 2. PLAY WITH SLIDERS
# dy_4
number_slider = Slider(0, range=-2..2)
# dx_0
# dy_0
number_slider_2 = Slider(0, range=-1..1)
# dy_4
number_slider_3 = Slider(0, range=-1..1)
# SET INITIAL VALUES
# Truss Span
# y_0 (Initial)
number_slider_4 = Slider(4, range=0..10)
# dx_0
# dy_0
number_slider_5 = Slider(0, range=-1..1)
G = Gate(toggle)
data = Data(toggle_2)
num = Number("-2")
num_2 = Number("-2")
num_3 = Number("2")
int_2 = Integer(int)
num_4 = Number("-1")
num_5 = Number("3")
int_3 = Integer(int)
num_6 = Number("1")
int_4 = Integer(int)
dom = ConstructDomain(DomainStart=num, DomainEnd=num_3)
dom_2 = ConstructDomain(DomainStart=num_2, DomainEnd=num_5)
dom_3 = ConstructDomain(DomainStart=num_4, DomainEnd=num_6)
num_7 = Number(number_slider_5)
num_8 = Number(Slider(0, range=-2..2))
num_9 = Number(number_slider_3)
num_10 = Number(Slider(1, range=-2..2))
num_11 = Number(number_slider_4)
range = Range(Domain=dom, Steps=int_2)
range_2 = Range(Domain=dom_2, Steps=int_3)
range_3 = Range(Domain=dom_3, Steps=int_4)
neg = Negative(Value=num_10)
num_12 = Number(number_slider_2)
num_13 = Number(Slider(0, range=-2..3))
num_14 = Number(number_slider)
dy_0 = Panel(range_2)
dy_4 = Panel(range)
dx_0 = Panel(range_3)
G_2 = Gate(G)
num_15 = Number(num_12)
num_16 = Number(num_7)
G_3 = Gate(G)
G_4 = Gate(G)
num_17 = Number(num_13)
num_18 = Number(num_14)
num_19 = Number(num_8)
num_20 = Number(num_9)
colibri_in = ColibriInputsIterator(dy_4=dy_4, dx_0=dx_0, dy_0=dy_0, ignoreAllWarningMsg=True)  # -> U, IP, dy_4, dx_0, dy_0, V_N
num_21 = Number(colibri_in.dx_0)
num_22 = Number(colibri_in.dy_4)
num_23 = Number(colibri_in.dy_0)
panel = Panel(num_22)
panel_2 = Panel(num_21)
panel_3 = Panel(num_23)
_0 = Stream0(neg)
num_24 = Number(num_11)
num_25 = Number(_0)
num_26 = Number(flatten(panel_3))
num_27 = Number(num_26)
filter = StreamFilter(Gate=G_3, Stream0=num_17, Stream1=num_27)
addition = Addition(A=filter, B=num_19)
_0_2 = Stream0(addition)
num_28 = Number(_0_2)
num_29 = Number(flatten(panel_2))
num_30 = Number(num_29)
filter_2 = StreamFilter(Gate=G_2, Stream0=num_15, Stream1=num_30)
addition_2 = Addition(A=filter_2, B=num_16)
_0_3 = Stream0(addition_2)
num_31 = Number(_0_3)
num_32 = Number(flatten(panel))
num_33 = Number(num_32)
filter_3 = StreamFilter(Gate=G_4, Stream0=num_18, Stream1=num_33)
addition_3 = Addition(A=filter_3, B=num_20)
_0_4 = Stream0(addition_3)
num_34 = Number(_0_4)
num_35 = Number(num_24)
num_36 = Number(num_24)
division = Division(A=num_35, B="2")
division_2 = Division(A=num_36, B="4")
num_37 = Number(division)
num_38 = Number(division_2)
num_39 = Number(num_31)
num_40 = Number(num_38)
num_41 = Number(num_24)
subtraction = Subtraction(A=num_41, B=num_40)
num_42 = Number(subtraction)
num_43 = Number(num_28)
num_44 = Number(num_28)
num_45 = Number(num_25)
num_46 = Number(num_25)
num_47 = Number(num_31)
# BUILD TRUSS
num_48 = Number(num_38)
addition_4 = Addition(A=num_45, B=num_43)
addition_5 = Addition(A=num_46, B=num_44)
subtraction_2 = Subtraction(A=num_42, B=num_39)
addition_6 = Addition(A=num_48, B=num_47)
num_49 = Number(num_34)
num_50 = Number(num_37)
num_51 = Number(addition_4)
num_52 = Number(addition_5)
num_53 = Number(addition_6)
panel_4 = Panel(num_49)
num_54 = Number(num_24)
pt = ConstructPoint(XCoordinate=subtraction_2, YCoordinate=num_52, ZCoordinate="0")
pt_2 = ConstructPoint(XCoordinate=num_53, YCoordinate=num_51, ZCoordinate="0")
pt_3 = ConstructPoint(XCoordinate="0", YCoordinate="0", ZCoordinate="0")
pt_4 = ConstructPoint(XCoordinate=num_54, YCoordinate="0", ZCoordinate="0")
pt_5 = ConstructPoint(XCoordinate=num_50, YCoordinate=panel_4, ZCoordinate="0")
pt_6 = Point(pt_2)
pt_7 = Point(pt)
pt_8 = Point(pt_4)
pt_9 = Point(pt_3)
pt_10 = Point(pt_5)
pt_11 = Point(pt_9)
pt_12 = Point(pt_6)
pt_13 = Point(pt_8)
pt_14 = Point(pt_10)
pt_15 = Point(pt_7)
merge = Merge(Data1=pt_12, Data2=pt_15, Data3=pt_11, Data4=pt_13, Data5=pt_14)
pt_16 = Point(merge)
pt_17 = Point(pt_16)
average = Average(Input=pt_17)
subtraction_3 = Subtraction(A=pt_17, B=average)
ln = Line(StartPoint=pt_11, EndPoint=pt_12)
unit_vector = UnitVector(Vector=subtraction_3)
crv = Curve(ln)
multiplication = Multiplication(A=unit_vector, B=Slider(0.321, range=0..1))
ln_2 = Line(StartPoint=pt_11, EndPoint=pt_14)
move = Move(Geometry=pt_17, Motion=multiplication)  # -> Geometry, Transform
ln_3 = Line(StartPoint=pt_12, EndPoint=pt_14)
crv_2 = Curve(ln_2)
ln_4 = Line(StartPoint=pt_12, EndPoint=pt_15)
crv_3 = Curve(ln_3)
points = PointList(Points=move.Geometry, Size=Slider(0.2, range=0..10))
crv_4 = Curve(ln_4)
ln_5 = Line(StartPoint=pt_15, EndPoint=pt_14)
ln_6 = Line(StartPoint=pt_14, EndPoint=pt_13)
crv_5 = Curve(ln_5)
crv_6 = Curve(ln_6)
ln_7 = Line(StartPoint=pt_13, EndPoint=pt_15)
crv_7 = Curve(ln_7)
merge_2 = Merge(Data1=pt_11, Data2=pt_13, Data3=pt_12, Data4=pt_15, Data5=pt_14)
merge_3 = Merge(Data1=crv, Data2=crv_7, Data3=crv_4, Data4=crv_2, Data5=crv_6, Data6=crv_3, Data7=crv_5)
merge_4 = Merge(Data1=pt_11, Data2=pt_13)
num_55 = Number(Slider(100, range=0..100))
pt_18 = Point(merge_2)
pt_19 = Point(merge_4)
crv_8 = Curve(merge_3)
crv_9 = Curve(crv_8)
neg_2 = Negative(Value=num_55)
custom_preview_lineweights = CustomPreviewLineweights(
    Geometry=crv_9,
    Shader={diffuse=RGB(255, 105, 180), emission=RGB(76, 32, 54), shine=0.5, specular=RGB(255, 255, 255), transparency=0},
    Thickness=ColourSwatch(SwatchColor=RGB(0, 0, 0)),
    Absolute=False)
Y = UnitY(Factor=neg_2)
force = ForceVector(Y)
pt_20 = Point(pt_14)
pt_21 = Point(pt_19)
pt_22 = Point(pt_18)
crv_10 = Curve(crv_8)
supp = SupportKaramba3D(PosInd=pt_22, menu=[buttons(off, off, on, off, off, off)])
supp_2 = SupportKaramba3D(PosInd=pt_21, menu=[buttons(on, on, off, off, off, off)])
loads = LoadsKaramba3D(ForceVector=force, Local=False, PosInd=pt_20, LCase="0", mode="Point")
load = LoadKaramba3D(loads)
support = Support(supp_2)
support_2 = Support(supp)
merge_5 = Merge(Data1=support, Data2=support_2)
support_3 = Support(merge_5)
load_2 = LoadKaramba3D(load)
support_4 = Support(support_3)
# Create Cross Sections
number_slider_6 = Slider(1, range=0..10)
number = Number(Slider(20, range=0..100))
integer = Integer(Slider(50, range=0..100))
number_2 = Number(number_slider_6)
construct_domain = ConstructDomain(DomainStart=number_2, DomainEnd=number)
range_4 = Range(Domain=construct_domain, Steps=integer)
number_3 = Number(range_4)
list_length = ListLength(List=number_3)
concatenate = Concatenate(FragmentA="circle_solid_", FragmentB=number_3)
integer_division = IntegerDivision(A=list_length, B="2")
text = Text(concatenate)
number_4 = Number(number_3)
cross_section_karamba3d = CrossSectionKaramba3D(
    FamilyNameOfCrossSection="DefaultCroSec",
    NameOfCrossSection=text,
    Diameter_cm=number_4,
    WallThickness_cm=expr("x/2", number_4),
    mode="Circular Hollow")
cross_sections = CrossSections(cross_section_karamba3d)
cross_section_selector_karamba3d = CrossSectionSelectorKaramba3D(CrossSections=cross_sections, NameOrListIndexOfCrossSection=integer_division)  # -> CrossSection, Info
cross_sections_2 = CrossSections(cross_section_selector_karamba3d.CrossSection)
crosec = CrossSection(cross_sections_2)
# STRUCTURAL ANALYSIS
linetobeam = LineToBeamKaramba3D(
    Line=crv_10,
    CrossSection=crosec,
    New=True,
    Remove=True,
    LimitDistance_m=0.005,
    Bending=True,
    SetBucklingLength=True,
    ToPolylineMaxAngle=0.03,
    ToPolylineTolerance=0.01,
    ToPolylineMaxEdgeLength=0.25)  # -> Element, Points, Info
elem = Elem(linetobeam.Element)
elem_2 = Elem(elem)
assemble = AssembleModelKaramba3D(Elem=elem_2, Support=support_4, Load=load_2, LimitDistance_m=0.005)  # -> Model, Info, Mass_kg, CenterOfGravity, LoadCaseNames
model = Model(assemble.Model)
analyze = AnalyzeKaramba3D(Model=model)  # -> CalculatedModel, MaximumDisplacement_cm, ResultingForceOfGravity_kN, ElasticEnergyChange_kNm
model_2 = Model(analyze.CalculatedModel)
b_forces = BeamForcesKaramba3D(AnalyzedModel=model_2, Ts=[0, 1])  # -> AnalyzedModel, NormalForce_kN, ShearForceVz_kN, ShearForceVy_kN, TorsionalMomentMt_kNm, flatten(BendingMomentMy_kNm), flatten(BendingMomentMz_kNm)
num_56 = Number(analyze.MaximumDisplacement_cm)
num_57 = Number(analyze.ElasticEnergyChange_kNm)
num_58 = Number(assemble.Mass_kg)
num_59 = Number(num_56)
num_60 = Number(num_58)
num_61 = Number(num_57)
cross_sections_3 = CrossSections(cross_section_karamba3d)
cross_sections_4 = CrossSections(cross_section_karamba3d)
panel_5 = Panel(num_60)
panel_6 = Panel(num_59)
panel_7 = Panel(num_61)
# STRUCTURAL CROSS SECTION OPTIM
model_karamba3d = ModelKaramba3D(model)
cross_sections_5 = CrossSections(cross_sections)
optimize_cross_section_karamba3d = OptimizeCrossSectionKaramba3D(
    Model=model_karamba3d,
    CrossSections=cross_sections_5,
    MaximumUtilization=1,
    UltimateLimitStateIterations=5,
    DisplacementIterations=5,
    NumberOfSamplePoints=3,
    ElasticDesign=True,
    GammaM0=1,
    GammaM1=1.1,
    SwayFrame=True)  # -> ModelWithOptimizedCrossSections, Info, Mass_kg, MaximumDisplacement_cm, ElasticEnergyChange_kNm
number_5 = Number(optimize_cross_section_karamba3d.Mass_kg)
mass_cs_optimised = Panel(number_5)
data_2 = Data(data)
model_karamba3d_2 = ModelKaramba3D(optimize_cross_section_karamba3d.ModelWithOptimizedCrossSections)
number_6 = Number(optimize_cross_section_karamba3d.ElasticEnergyChange_kNm)
number_7 = Number(number_6)
energy_cs_optimised = Panel(number_7)
number_8 = Number(optimize_cross_section_karamba3d.MaximumDisplacement_cm)
# Final Performance
number_9 = Number(number_8)
deflection_cs_optimised = Panel(number_9)
panel_8 = Panel(b_forces.BendingMomentMz_kNm)
model_karamba3d_3 = ModelKaramba3D(model_karamba3d_2)
disassemble_model_karamba3d = DisassembleModelKaramba3D(Model=model_karamba3d_2)  # -> Model, Point, Beam, Shell, Support, Load, Line, Mesh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
utilization_of_elements_karamba3d = UtilizationOfElementsKaramba3D(
    AnalyzedModel=model_karamba3d_3,
    NumberOfSamplePoints=3,
    ElasticDesign=True,
    GammaM0=1,
    GammaM1=1.1,
    SwayFrame=True,
    WithDetails=False,
    mode="Beams")  # -> AnalyzedModel, Utilization, SigMax_kN_cm2, SigMin_kN_cm2, TauMax_kN_cm2, UtilN, UtilVy, UtilVz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
model_3 = Model(model_karamba3d_2)
modelview = ModelViewKaramba3D(Model=model_3, ResultFactors=1, ResultCase=-1)  # -> Model, DeformedMesh, DeformedAxes, DeformedModel
disassemble_element_karamba3d = DisassembleElementKaramba3D(Element=disassemble_model_karamba3d.Beam)  # -> Element, ElementIdentifier, AxisOfElement, CrossSection, Joint, Material, LocalCoordinateSystem, ElementIsActive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
list_length_2 = ListLength(List=utilization_of_elements_karamba3d.Utilization)
beamview = BeamViewKaramba3D(Model=modelview.Model)  # -> Model, MeshesOfRenderedBeams, DeformedBeamAxes, LegendColors, LegendTags
series = Series(Start=0, Step=1, Count=list_length_2)
sort_list = SortList(Keys=utilization_of_elements_karamba3d.Utilization, ValuesValuesA=series)  # -> Keys, ValuesValuesA
disassemble_cross_section_karamba3d = DisassembleCrossSectionKaramba3D(CroSec=disassemble_element_karamba3d.CrossSection)  # -> CrossSection, FamilyNameOfCrossSection, TypeNameOfCrossSection, ElemIdentifiers, Color, Material, LocalEccentricity_cm, Heights_cm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
list_item = ListItem(List=sort_list.ValuesValuesA, Index=0, Wrap=True)  # -> Item1, Item
number_10 = Number(list_item.Item)
number_11 = Number(list_item.Item1)
list_item_2 = ListItem(List=sort_list.Keys, Index=0, Wrap=True)  # -> Item1, Item
number_slider_7 = Slider(2, range=0..10)  # disabled
# Always Make Sure No Elements Are Failing!!
panel_9 = Panel(sort_list.ValuesValuesA)
number_12 = Number(list_item_2.Item)
number_13 = Number(list_item_2.Item1)
curve = Curve(disassemble_element_karamba3d.AxisOfElement)  # disabled
number_14 = Number(disassemble_cross_section_karamba3d.Area_cm2)  # disabled
larger_than = LargerThan(FirstNumber=number_13, SecondNumber="1")  # -> LargerThan, OrEqualTo
panel_10 = Panel(sort_list.Keys)
colour_swatch = ColourSwatch(SwatchColor=RGB(0, 0, 0))  # disabled
multiplication_2 = Multiplication(A=number_14, B=number_slider_7)  # disabled
custom_preview_lineweights_2 = CustomPreviewLineweights(Geometry=curve, Shader=colour_swatch, Thickness=multiplication_2, Absolute=False)  # disabled
max_utilisation = Panel(number_13)
min_utilisation = Panel(number_12)
data_3 = Data(larger_than.LargerThan)
data_4 = Data(data_3)
failing = Panel(data_4)

# ---- group: Collect Outputs
colibri_out = ColibriOutputs(
    Deflection=flatten(panel_6),
    Mass=flatten(panel_5),
    SE=flatten(num_61),
    Mass_CSOptim=flatten(number_5),
    Deflection_CSOptim=flatten(number_9),
    SE_CSOptim=flatten(number_7),
    HasFailed_CSOptim=flatten(data_4))

# ----
ca = ColibriAggregator(Folder="C:\Colibri", Inputs=colibri_in.IP, Outputs=colibri_out, Write=data_2, recordingMode=0)
failing_2 = Panel(data_3)
