# Grasshopper definition basic_truss_goat.gh (Grasshopper 1.0.8)
# plug-ins: Karamba3D, CORE.Grasshopper.Colibri, goat

number_slider = Slider(0, range=-2..3)
# SET INITIAL VALUES
number_slider_2 = Slider(0, range=-2..3)
# NAVIGATE WITH SLIDERS
# dy_4
number_slider_3 = Slider(0, range=-2..2)
# dx_0
# dy_0
number_slider_4 = Slider(0, range=-1..1)
# NAVIGATE MANUALLY
# dy_4
number_slider_5 = Slider(0, range=-2..2)
# dx_0
# dy_0
number_slider_6 = Slider(0, range=-1..1)
# dy_4
# dx_0
number_slider_7 = Slider(0, range=-1..1)
# Truss Span
# y_0 (Initial)
number_slider_8 = Slider(4, range=0..10)
# dy_0
number_slider_9 = Slider(0, range=-1..1)
# Start Data Recorder
# Activation for Goat:
# https://www.rechenraum.com/en/goat.html
toggle = BooleanToggle(False)
data = Data(toggle)
num = Number(number_slider_7)
num_2 = Number(number_slider_9)
num_3 = Number(Slider(0, range=-2..2))
num_4 = Number(Slider(1, range=-2..2))
num_5 = Number(number_slider_8)
neg = Negative(Value=num_4)
num_6 = Number(number_slider_4)
num_7 = Number(number_slider)
num_8 = Number(number_slider_6)
num_9 = Number(number_slider_2)
num_10 = Number(number_slider_3)
num_11 = Number(number_slider_5)
goat = Goat(fitness=num_51, gene=[number_slider_3, number_slider_4, number_slider])
G = Gate(0)
num_12 = Number(num_6)
num_13 = Number(num_2)
num_14 = Number(num_8)
G_2 = Gate(0)
G_3 = Gate(0)
num_15 = Number(num_7)
num_16 = Number(num_3)
num_17 = Number(num_10)
num_18 = Number(num)
num_19 = Number(num_9)
num_20 = Number(num_11)
filter = StreamFilter(Gate=G, Stream0=num_12, Stream1=num_14)
filter_2 = StreamFilter(Gate=G_3, Stream0=num_17, Stream1=num_20)
filter_3 = StreamFilter(Gate=G_2, Stream0=num_15, Stream1=num_19)
addition = Addition(A=filter, B=num_13)
addition_2 = Addition(A=filter_3, B=num_16)
addition_3 = Addition(A=filter_2, B=num_18)
_0 = Stream0(addition)
_0_2 = Stream0(addition_3)
_0_3 = Stream0(addition_2)
_0_4 = Stream0(neg)
num_21 = Number(_0)
num_22 = Number(_0_3)
num_23 = Number(_0_2)
num_24 = Number(num_5)
num_25 = Number(_0_4)
num_26 = Number(num_24)
num_27 = Number(num_24)
division = Division(A=num_26, B="2")
division_2 = Division(A=num_27, B="4")
num_28 = Number(division)
num_29 = Number(division_2)
num_30 = Number(num_21)
num_31 = Number(num_29)
num_32 = Number(num_24)
subtraction = Subtraction(A=num_32, B=num_31)
num_33 = Number(subtraction)
num_34 = Number(num_22)
num_35 = Number(num_22)
num_36 = Number(num_25)
num_37 = Number(num_25)
num_38 = Number(num_21)
# BUILD TRUSS
num_39 = Number(num_29)
addition_4 = Addition(A=num_36, B=num_34)
addition_5 = Addition(A=num_37, B=num_35)
subtraction_2 = Subtraction(A=num_33, B=num_30)
addition_6 = Addition(A=num_39, B=num_38)
num_40 = Number(num_23)
num_41 = Number(num_28)
num_42 = Number(addition_4)
num_43 = Number(addition_5)
num_44 = Number(addition_6)
panel = Panel(num_40)
num_45 = Number(num_24)
pt = ConstructPoint(XCoordinate=subtraction_2, YCoordinate=num_43, ZCoordinate="0")
pt_2 = ConstructPoint(XCoordinate=num_44, YCoordinate=num_42, ZCoordinate="0")
pt_3 = ConstructPoint(XCoordinate="0", YCoordinate="0", ZCoordinate="0")
pt_4 = ConstructPoint(XCoordinate=num_45, YCoordinate="0", ZCoordinate="0")
pt_5 = ConstructPoint(XCoordinate=num_41, YCoordinate=panel, ZCoordinate="0")
pt_6 = Point(pt_2)
pt_7 = Point(pt)
pt_8 = Point(pt_3)
pt_9 = Point(pt_4)
pt_10 = Point(pt_5)
pt_11 = Point(pt_8)
pt_12 = Point(pt_9)
pt_13 = Point(pt_6)
pt_14 = Point(pt_10)
pt_15 = Point(pt_7)
merge = Merge(Data1=pt_13, Data2=pt_15, Data3=pt_11, Data4=pt_12, Data5=pt_14)
pt_16 = Point(merge)
ln = Line(StartPoint=pt_11, EndPoint=pt_13)
crv = Curve(ln)
ln_2 = Line(StartPoint=pt_11, EndPoint=pt_14)
points = PointList(Points=pt_16, Size=Slider(0.5, range=0..10))
ln_3 = Line(StartPoint=pt_13, EndPoint=pt_14)
crv_2 = Curve(ln_2)
ln_4 = Line(StartPoint=pt_13, EndPoint=pt_15)
crv_3 = Curve(ln_3)
crv_4 = Curve(ln_4)
ln_5 = Line(StartPoint=pt_15, EndPoint=pt_14)
ln_6 = Line(StartPoint=pt_14, EndPoint=pt_12)
crv_5 = Curve(ln_5)
crv_6 = Curve(ln_6)
ln_7 = Line(StartPoint=pt_12, EndPoint=pt_15)
crv_7 = Curve(ln_7)
merge_2 = Merge(Data1=pt_11, Data2=pt_12, Data3=pt_13, Data4=pt_15, Data5=pt_14)
merge_3 = Merge(Data1=crv, Data2=crv_7, Data3=crv_4, Data4=crv_2, Data5=crv_6, Data6=crv_3, Data7=crv_5)
merge_4 = Merge(Data1=pt_11, Data2=pt_12)
num_46 = Number(Slider(100, range=0..100))
pt_17 = Point(merge_2)
pt_18 = Point(merge_4)
crv_8 = Curve(merge_3)
neg_2 = Negative(Value=num_46)
Y = UnitY(Factor=neg_2)
force = ForceVector(Y)
pt_19 = Point(pt_14)
pt_20 = Point(pt_18)
pt_21 = Point(pt_17)
crv_9 = Curve(crv_8)
loads = LoadsKaramba3D(ForceVector=force, Local=False, PosInd=pt_19, LCase="LC0", mode="Point")
supp = SupportKaramba3D(PosInd=pt_21, menu=[buttons(off, off, on, off, off, off)])
supp_2 = SupportKaramba3D(PosInd=pt_20, menu=[buttons(on, on, off, off, off, off)])
# STRUCTURAL ANALYSIS
linetobeam = LineToBeamKaramba3D(
    Line=crv_9,
    New=True,
    Remove=True,
    LimitDistance_m=0.005,
    Bending=True,
    SetBucklingLength=True,
    ToPolylineMaxAngle=0.03,
    ToPolylineTolerance=0.01,
    ToPolylineMaxEdgeLength=0.25)  # -> Element, Points, Info
elem = Elem(linetobeam.Element)
load = LoadKaramba3D(loads)
support = Support(supp_2)
support_2 = Support(supp)
merge_5 = Merge(Data1=support, Data2=support_2)
support_3 = Support(merge_5)
elem_2 = Elem(elem)
load_2 = LoadKaramba3D(load)
support_4 = Support(support_3)
assemble = AssembleModelKaramba3D(Elem=elem_2, Support=support_4, Load=load_2, LimitDistance_m=0.005)  # -> Model, Info, Mass_kg, CentreOfGravity, LoadCaseNames
model = Model(assemble.Model)
analyze = AnalyzeKaramba3D(Model=model)  # -> CalculatedModel, MaximumDisplacement_cm, ResultingForceOfGravity_kN, ElasticEnergyChange_kNm
num_47 = Number(num_10)
num_48 = Number(num_7)
num_49 = Number(num_6)
model_2 = Model(analyze.CalculatedModel)
b_forces = BeamForcesKaramba3D(AnalysedModel=model_2, Ts=[0, 1])  # -> Model, NormalForce_kN, ShearForceVz_kN, ShearForceVy_kN, TorsionalMomentMt_kNm, flatten(BendingMomentMy_kNm), flatten(BendingMomentMz_kNm), LoadCaseIndex
num_50 = Number(analyze.MaximumDisplacement_cm)
num_51 = Number(num_50)
num_52 = Number(assemble.Mass_kg)
num_53 = Number(num_52)
panel_2 = Panel(b_forces.BendingMomentMz_kNm)
panel_3 = Panel(num_48)
panel_4 = Panel(num_47)
panel_5 = Panel(num_49)
panel_6 = Panel(num_53)
panel_7 = Panel(num_51)
panel_8 = Panel(num_53)
model_3 = Model(model_2)
modelview = ModelViewKaramba3D(Model=model_3, ResultFactors=1, ResultCase=-1)  # -> Model, DeformedMesh, DeformedAxes, DeformedModel
beamview = BeamViewKaramba3D(Model=modelview.Model)  # -> Model, MeshesOfRenderedBeams, DeformedBeamAxes, LegendColours, LegendTags

# ---- group: Collect Outputs
colibri_out = ColibriOutputs(Deflection=flatten(panel_7), Mass=flatten(panel_6))

colibri_out_2 = ColibriOutputs(Deflection=flatten(panel_4), Mass=flatten(panel_5), D_3=flatten(panel_3))

# ----
data_2 = Data(data)
ca = ColibriAggregator(Folder="C:\Colibri", Inputs=colibri_out_2, Outputs=colibri_out, Write=data_2, recordingMode=0)
