# Grasshopper definition 2D_2bar.gh (Grasshopper 1.0.7)
# plug-ins: Karamba3D

# Span
number_slider = Slider(3.17, range=0..10)
# Length
number_slider_2 = Slider(6, range=0..10)
construct_point = ConstructPoint(XCoordinate=0, YCoordinate=0, ZCoordinate=0)
construct_point_2 = ConstructPoint(XCoordinate=number_slider_2, YCoordinate=0, ZCoordinate=0)
construct_point_3 = ConstructPoint(XCoordinate=expr("x/2", number_slider_2), YCoordinate=0, ZCoordinate=number_slider)
point = Point(construct_point)
point_2 = Point(construct_point_2)
line = Line(StartPoint=point, EndPoint=point_2)
point_3 = Point(construct_point_3)
line_2 = Line(StartPoint=point_3, EndPoint=point)
line_3 = Line(StartPoint=point_3, EndPoint=point_2)
number = Number(Slider(20, range=0..100))
curve = Curve(line_2)
curve_2 = Curve(line_3)
material_properties_karamba3d = MaterialPropertiesKaramba3D(
    FamilyOfMaterial="Steel",
    Name="S235",
    YoungsModulus_kN_cm2=21000,
    InPlaneShearModulus_kN_cm2=8076,
    TransverseShearModulus_kN_cm2=8076,
    SpecificWeight_kN_m3=Slider(80.9, range=0..200),
    CoefficientOfThermalExpansion_1_C=1.2e-05,
    TensileStrength_kN_cm2=23.5,
    CompressiveStrength_kN_cm2=-23.5,
    StrengthHypothesis="MISES",
    mode="Isotrop")
cross_section_karamba3d = CrossSectionKaramba3D(
    FamilyNameOfCrossSection="DefaultCroSec",
    Height_cm=number,
    UpperFlangeWidth_cm=number,
    LowerFlangeWidth_cm=number,
    UpperFlangeThickness_cm=expr("x/2-0.001", number),
    LowerFlangeThickness_cm=expr("x/2-0.001", number),
    SidewallsThickness_cm=expr("x/2-0.001", number),
    FilletRadius_cm=0.6,
    mode="Box")
merge = Merge(Data1=curve, Data2=curve_2)
point_4 = Point(point)
point_5 = Point(point_3)
point_6 = Point(point_2)
material_karamba3d = MaterialKaramba3D(material_properties_karamba3d)
cross_section_karamba3d_2 = CrossSectionKaramba3D(cross_section_karamba3d)
negative = Negative(Value=Slider(100, range=0..100))
line_4 = Line(merge)
unit_z = UnitZ(Factor=negative)
support_karamba3d = SupportKaramba3D(PosInd=[point_6, point_4, point_5], menu=[buttons(off, on, off, off, off, off)])
support_karamba3d_2 = SupportKaramba3D(PosInd=[point_4, point_6], menu=[buttons(on, off, on, off, on, off)])
line_to_beam_karamba3d = LineToBeamKaramba3D(
    Line=line_4,
    CrossSection=cross_section_karamba3d_2,
    New=True,
    Remove=True,
    LimitDistance_m=0.005,
    Bending=True,
    SetBucklingLength=True,
    ToPolylineMaxAngle=0.03,
    ToPolylineTolerance=0.01,
    ToPolylineMaxEdgeLength=0.25)  # -> Element, Points, Info
loads_karamba3d = LoadsKaramba3D(ForceVector=unit_z, Local=False, PosInd=point_5, LCase="0", mode="Point")
loads_karamba3d_2 = LoadsKaramba3D(Vector=Vector(0, 0, -1), LCase="0", mode="Gravity")
support = Support(flatten([support_karamba3d_2, support_karamba3d]))
load = Load([loads_karamba3d, loads_karamba3d_2])
elem = Elem(line_to_beam_karamba3d.Element)
assemble_model_karamba3d = AssembleModelKaramba3D(Elem=elem, Support=support, Load=load, Material=material_karamba3d, LimitDistance_m=0.005)  # -> Model, Info, Mass_kg, CenterOfGravity, LoadCaseNames
model = Model(assemble_model_karamba3d.Model)
analyze_karamba3d = AnalyzeKaramba3D(Model=model)  # -> CalculatedModel, MaximumDisplacement_cm, ResultingForceOfGravity_kN, ElasticEnergyChange_kNm
strain_energy_stiffness = Panel(analyze_karamba3d.ElasticEnergyChange_kNm)
deflection = Panel(analyze_karamba3d.MaximumDisplacement_cm)
model_2 = Model(analyze_karamba3d.CalculatedModel)
model_view_karamba3d = ModelViewKaramba3D(Model=model_2, ResultFactors=1, ResultCase=-1)  # -> Model, DeformedMesh, DeformedAxes, DeformedModel
beam_view_karamba3d = BeamViewKaramba3D(Model=model_view_karamba3d.Model)  # -> Model, MeshesOfRenderedBeams, DeformedBeamAxes, LegendColors, LegendTags
